# Grasshopper definition Orca.gh (Grasshopper 1.0.8)
# plug-ins: RhinoCodePluginGH, LadybugGrasshopper

falsestart = LBFalseStartToggle(False)
install = Python3Script(run=falsestart)  # -> Status
# ---------- install: Python ----------
import os
import shutil

doc = ghenv.Component.OnPingDocument()
gh_path = doc.FilePath
gh_dir = os.path.dirname(gh_path)

user_dir = r'C:\Users'
user_names = [f for f in os.listdir(user_dir) if os.path.isdir(os.path.join(user_dir, f))]
Status = []

libraries = ['orca']
userobjects = ['Orca']

if _run:
    for user_name in user_names:
        _path = os.path.join(user_dir, user_name, 'AppData', 'Roaming', 'McNeel', 'Rhinoceros', '8.0')
        if os.path.isdir(_path):
            scr_dir = os.path.join(_path, 'scripts')
            os.makedirs(scr_dir, exist_ok=True)
            for _lib in libraries:
                _lib_path = os.path.join(scr_dir, _lib)
                if os.path.exists(_lib_path):
                    shutil.rmtree(_lib_path)
            copy_path = shutil.copytree(os.path.join(gh_dir, 'scripts'), scr_dir, dirs_exist_ok=True)
            Status.append(copy_path)
    
    for user_name in user_names:
        _path = os.path.join(user_dir, user_name, 'AppData', 'Roaming', 'Grasshopper')
        if os.path.isdir(_path):
            scr_dir = os.path.join(_path, 'UserObjects')
            os.makedirs(scr_dir, exist_ok=True)
            for _uo in userobjects:
                _uo_path = os.path.join(scr_dir, _uo)
                if os.path.exists(_uo_path):
                    shutil.rmtree(_uo_path)
            copy_path = shutil.copytree(os.path.join(gh_dir, 'UserObjects'), scr_dir, dirs_exist_ok=True)
            Status.append(copy_path)

if len(Status) == 2:
    Status.append('The installation of Orca was successful. ')

else:
    Status.append('The installation has not been performed.')
# ---------- end install ----------
panel = Panel(install)
