# Grasshopper definition ArcClimate.gh (Grasshopper 1.0.8)
# plug-ins: RhinoCodePluginGH

# ----
# Input
latitude_and_longitude_from_goolge_map = Panel("35.71426019899661, 139.76013636661017")
number_slider = Slider(2019, range=2011..2020)
file_name = Panel("TokyoUni")
path = FilePath("C:\Projects\GHDevelopment\sample\ArcClimate\")

merge = Merge(Data1=file_name, Data2=number_slider)
split = TextSplit(Text=latitude_and_longitude_from_goolge_map, Separators=",")
num = Number(split)
item = ListItem(List=num, Index=0, Wrap=True)  # -> Item, Item1
join = TextJoin(Text=merge, Join="_")

# ----
# Input Check
output_directory = Panel(path)
latitude = Panel(item.Item)
longitude = Panel(item.Item1)

orcaepwfromarchclimate = _07OrcaEPWFromArchClimate(Latitude=latitude, Longitude=longitude, Year=number_slider, OutputDir=output_directory, FileName=join, Run=Toggle(True))  # -> OK, Message, EPWPath; inputs Latitude: Double, Longitude: Double, Year: Int32, OutputDir: String, FileName: String, Run: Boolean
# ---------- orcaepwfromarchclimate: Python ----------
"""
Grasshopper Python 3 component script for 07.OrcaEPWFromArchClimate.

Inputs:
    Latitude, Longitude, Year, OutputDir, FileName, Run

Outputs:
    OK, Message, EPWPath
"""

import traceback

try:
    from orca.arc_climate import ArcClimateClient
except ImportError:
    ArcClimateClient = None


OK = False
Message = ""
EPWPath = None

try:
    if not Run:
        Message = "Run=False"
    else:
        if ArcClimateClient is None:
            raise ImportError(
                "Failed to import ArcClimateClient from orca.arc_climate. "
                "Ensure scripts/orca is on the Python path and arcclimate is installed."
            )

        if Latitude is None:
            raise ValueError("Latitude is required.")
        if Longitude is None:
            raise ValueError("Longitude is required.")
        if Year is None:
            raise ValueError("Year is required.")
        if not OutputDir:
            raise ValueError("OutputDir is required.")
        if not FileName:
            raise ValueError("FileName is required.")

        client = ArcClimateClient(
            lat=float(Latitude),
            lon=float(Longitude),
            year=int(Year),
        )
        client.validate_inputs()

        Message = "Fetching MSM data from ArcClimate..."
        client.fetch()

        Message = "Writing EPW file..."
        EPWPath = client.to_epw(OutputDir, FileName)

        OK = True
        Message = "Completed: {0}".format(EPWPath)

except Exception as e:
    OK = False
    Message = str(e) + "\n" + traceback.format_exc()
# ---------- end orcaepwfromarchclimate ----------
panel = Panel(orcaepwfromarchclimate.EPWPath)
